% Simulink data dictionary AutoSarNm.sldd

AutoSarNM_cntNmMsgRxCnt = Simulink.Signal(StorageClass="ImportedExtern", DataType="uint8")
AUROSAR_NM_MODEL_RUN_STEP = Simulink.Parameter(10, StorageClass="Define", DataType="uint32")
AutoSarNM_cntUDSMsgRxCnt = Simulink.Signal(StorageClass="ImportedExtern", DataType="uint8")
AUROSAR_NM_UDS_OVERTIME = Simulink.Parameter(5000, StorageClass="Define", HeaderFile="NMmain.h", DataType="uint32")
BSW_stKL15 = Simulink.Signal(StorageClass="ImportedExtern", DataType="uint8")
CAN_ID_VEH_RX_NM = Simulink.Parameter(uint32(418316033), StorageClass="Define", HeaderFile="NMmain.h")
AutoSarNM_stWKUPMode = Simulink.Signal(StorageClass="ImportedExtern", DataType="uint8")
CANNM_BSM_WAITSLP_TIME = Simulink.Parameter(500, StorageClass="Define", HeaderFile="NMmain.h", DataType="uint32")
CANNM_IMMEDIATE_CYCLE_TIME = Simulink.Parameter(20, StorageClass="Define", HeaderFile="NMmain.h", DataType="uint32")
CANNM_cntAuroSarNMFrameSendCnt = Simulink.Signal(StorageClass="ImportedExtern", DataType="uint32")
CANNM_IMMEDIATE_TRANSMISSION_COUNT = Simulink.Parameter(10, StorageClass="Define", HeaderFile="NMmain.h", DataType="uint32")
CANNM_cntAuroSarNMFrameRecvCnt = Simulink.Signal(StorageClass="ImportedExtern", DataType="uint32")
CANNM_MSG_CYCLE_TIME = Simulink.Parameter(1000, StorageClass="Define", HeaderFile="NMmain.h", DataType="uint32")
CANNM_REPEAT_MEG_TIME = Simulink.Parameter(3300, StorageClass="Define", HeaderFile="NMmain.h", DataType="uint32")
CANNM_stRMSReq = Simulink.Signal(StorageClass="ImportedExtern", DataType="uint8")
CANNM_NM_TIMEOUT_TIME = Simulink.Parameter(2500, StorageClass="Define", HeaderFile="NMmain.h", DataType="uint32")
CANNM_WAIT_BUS_SLEEP_TIME = Simulink.Parameter(1500, StorageClass="Define", HeaderFile="NMmain.h", DataType="uint32")
AutoSarNM_sts = Simulink.Signal(StorageClass="ExportedGlobal", DataType="Enum:AutoSarNm_Sts_Enum")
AUROSAR_NM_CANWAKEUP_ENABLE = Simulink.Parameter(1, StorageClass="Define", HeaderFile="NMmain.h", DataType="uint32")

AutoSarNm_Sts_Enum = enum(DefaultValue="AutoSarNM_BSM")
  AutoSarNM_BSM = 0  % 这里请替换为你在字典中实际定义的成员与数值
  AutoSarNM_PBSM = 1
  AutoSarNM_RMS = 2
  AutoSarNM_NOS = 3
  AutoSarNM_RSS = 4
  AutoSarNM_INVAILD = 255

CAN_ID_VEH_TX_NM = Simulink.Parameter(536870910, StorageClass="ImportedDefine", HeaderFile="NMmain.h")

CAN_FD_MESSAGE_BUS = Simulink.Bus()
  ProtocolMode: uint8
  Extended: uint8
  Length: uint8
  Remote: uint8
  Error: uint8
  BRS: uint8
  ESI: uint8
  DLC: uint8
  ID: uint32
  Reserved: uint32
  Timestamp: double
  Data: uint8[64]

CAN_msgAutoSarNmFrame = Simulink.Signal(StorageClass="ExportedGlobal", DataType="Bus: CAN_FD_MESSAGE_BUS")
AUROSAR_NM_RDY2SLP_ENABLE = Simulink.Parameter(0, StorageClass="Define", HeaderFile="AutoSarNm.h", DataType="uint32")