% Simulink data dictionary ASP.sldd

BSW_stKL15 = Simulink.Signal(StorageClass="ImportedExtern", DataType="uint8")
ASP_stKL15 = Simulink.Signal(StorageClass="ExportedGlobal", DataType="uint8")
ASP_MODEL_CYCLE = Simulink.Parameter(20, StorageClass="Define", HeaderFile="ASP_Cfg.h", DataType="uint32")
ASP_HW_DEB_TIME = Simulink.Parameter(100, StorageClass="Define", HeaderFile="ASP_Cfg.h", DataType="uint32")