% Simulink data dictionary DSC.sldd

DSC_MODEL_CYCLE = Simulink.Parameter(50, StorageClass="Define", DataType="uint32")
ASW_stLEDR1Ctrl = Simulink.Signal(StorageClass="ExportedGlobal", DataType="uint8")
ASP_stKL15 = Simulink.Signal(StorageClass="ImportedExtern", DataType="uint8")
ASW_stLEDG1Ctrl = Simulink.Signal(StorageClass="ExportedGlobal", DataType="uint8")
BSW_u32UART6RxFrameCnt = Simulink.Signal(StorageClass="Volatile", HeaderFile="BSW_UART.h", DefinitionFile="BSW_UART.c", DataType="uint32")
BSW_cntCan0RxCnt = Simulink.Signal(StorageClass="ImportedExtern", DataType="uint32")
ASW_stLEDB1Ctrl = Simulink.Signal(StorageClass="ExportedGlobal", DataType="uint8")
ASW_stLEDY1Ctrl = Simulink.Signal(StorageClass="ExportedGlobal", DataType="uint8")